# Dynamo graph trial-facade.dyn (Dynamo 0.9.1.4062)

code_block = CodeBlock { 0..50..2; }
byCoordinates = Point.ByCoordinates(x=code_block, y=code_block, lacing=CrossProduct)
flatten = Flatten(byCoordinates)
number_slider = DoubleSlider(27.8, range=0..100 step 0.1)
number_slider_2 = DoubleSlider(15.4, range=0..100 step 0.1)
byCoordinates_2 = Point.ByCoordinates(x=number_slider, y=number_slider_2)
distanceTo = Geometry.DistanceTo(geometry=flatten, other=byCoordinates_2)
distance_limit = DoubleSlider(16.5, range=0..100 step 0.1)
gt = distanceTo > distance_limit
ordinary_radius = DoubleSlider(0.5, range=0..100 step 0.1)
code_block_2 = CodeBlock(n=distance_limit) { 0; n; 0; 0.5; }
mapTo = MapTo(code_block_2.out0, code_block_2.n, distanceTo, code_block_2.out2, code_block_2.out3)
if_ = If(test=gt, true=ordinary_radius, false=mapTo)
byCenterPointRadius = Circle.ByCenterPointRadius(centerPoint=flatten, radius=if_)
code_block_3 = CodeBlock { 6; }
regularPolygon = Polygon.RegularPolygon(circle=byCenterPointRadius, numberSides=code_block_3)
map = Map()
sub = code_block_2.out3 - mapTo
add = sub + ordinary_radius
